# Dynamo graph Closest Pair of Points.dyn (Dynamo 2.10.1.3976)

python_script = Python()  # IronPython2; unwired: IN[0], IN[1]
# ---------- python_script.python (57 lines) ----------
# Load the Python Standard and DesignScript Libraries
import sys
import clr
clr.AddReference('ProtoGeometry')
from Autodesk.DesignScript.Geometry import *

dyn_points = IN[0]
points = []
text = IN[1]


for p in dyn_points:
    points.append((p.X,p.Y))    

def dist(p1, p2):
    x1, y1 = p1
    x2, y2 = p2
    dis = ((x1-x2)**2 + (y1-y2)**2)**0.5
    return dis

def offices_to_merge(points):
    current_minimum = float('inf')
    min_p1 = -1
    min_p2 = -1
    for i in range(len(points)):
        for j in range(i+1, len(points)):
            dis = dist(points[i], points[j])
            if dis < current_minimum:
                min_p1 = i
                min_p2 = j
                current_minimum = dis
    return (min_p1, min_p2)
    
text_pair = offices_to_merge(points)
 
 
def pair_text(text,points):
    paired_text = []
    text_pair = offices_to_merge(points)
    
    paired_text.append(text.pop(text_pair[0]))
    paired_text.append(text.pop(text_pair[1]-1))
    
    points.pop(text_pair[0])
    points.pop(text_pair[1]-1)
    
    
    return paired_text

OUT = []
x = True
while x:
    if len(points) > 1:
        OUT.append(pair_text(text, points))
    else:
        x = False
        break
# ----------------------------------------
