# Dynamo graph Sine.dyn (Dynamo 2.10.1.3976)

number_slider = DoubleSlider(9.4, range=0..100 step 0.1)
integer_slider = IntegerSlider(54, range=-5..100 step 1)
python_script = Python(IN[0]=number_slider, IN[1]=integer_slider)  # CPython3
# ---------- python_script.python (25 lines) ----------
# Load the Python Standard and DesignScript Libraries
import sys
import clr
clr.AddReference('ProtoGeometry')
from Autodesk.DesignScript.Geometry import *
from math import * 
# The inputs to this node will be stored as a list in the IN variables.
freq = IN[0]
length = IN[1]
points = []

# Place your code below this line
def sine(freq = 0, length = 1):
    if length <= 1:
        return "The length must be greater than 1."
    else:    
        for i in range(length):
            x = 5 * i
            z = freq * sin(i)
            points.append(Point.ByCoordinates(x,0,z))
        curve = NurbsCurve.ByPoints(points)
        return curve

# Assign your output to the OUT variable.
OUT = sine(freq, length)
# ----------------------------------------
